# Dynamo graph AulaMatrizModular.dyn (Dynamo 2.17.0.3472)

quantidade_módulos_x = IntegerSlider(12, range=1..20 step 1)
quantidade_módulos_y = IntegerSlider(2, range=1..10 step 1)
dim_h = DoubleSlider(3, range=3..6 step 0.1)
dim_v = DoubleSlider(3.5, range=3..6 step 0.1)
quantidade_módulos_x_2 = IntegerSlider(67, range=0..100 step 1)
proporção = DoubleSlider(0.5, range=0..1 step 0.1)
módular = IntegerSlider(2, range=1..10 step 1)
code_block = CodeBlock(qx=quantidade_módulos_x, qy=quantidade_módulos_y, dx=dim_h, dy=dim_v, da=quantidade_módulos_x_2, p=proporção, mod=módular)
# ---------- code_block.designscript (30 lines) ----------
qx;
qy;
dx;
dy;
mdx = qx/2;
da;
dav = da%mdx;
m   = dx * p;

x = i%mod ? (i*dx+m) : (i * dx);
y = (0..qy) * dy;
i =  0..qx-1;
k =  0..qy-1;

//----------------------------------------
PH = Point.ByCoordinates(x<1>, y   , 0);
PV = Point.ByCoordinates(x   , y<1>, 0);
//----------------------------------------
VH = Line.ByStartPointEndPoint(PH[i], PH[i+1]);
VV = Line.ByStartPointEndPoint(PV[k], PV[k+1]);
//----------------------------------------------
PA = [
      Circle.ByCenterPointRadius(PH[ dav]  [ 0], 0.5),
      Circle.ByCenterPointRadius(PH[ dav]  [-1], 0.5),
      Circle.ByCenterPointRadius(PH[-dav-1][ 0], 0.5),
      Circle.ByCenterPointRadius(PH[-dav-1][-1], 0.5)
     ];
Key = [ "PH", "VH", "VV", "PA"];
Val = [  PH ,  VH ,  VV ,  PA ];
DIC = Dictionary.ByKeysValues ( Key ,  Val );
# ----------------------------------------
