# Dynamo graph Aula_PPE_10.dyn (Dynamo 3.0.3.7597)

# group: Treliça Espacial Equilátera
# Prof. José Luis Menegotto
# Escola Politécnica da UFRJ
quantidade_de_módulos = DoubleSlider(6, range=1..10 step 1)
dimensão_do_módulo = DoubleSlider(1, range=1..10 step 1)
apoios_em = DoubleSlider(0, range=0..2 step 1)
treliça_espacial_equilátera = CodeBlock(q=quantidade_de_módulos, d1=dimensão_do_módulo, ap=apoios_em)
# ---------- treliça_espacial_equilátera.designscript (46 lines) ----------
q;
d1;
ap;
d2  = d1/2;
//-----------------------------------------------------
alt = Math.Cos(60)*Math.Sqrt(2) * d1;
i   = 0..q-1;
k   = 0..q-2;
//-----------------------------------------------------
// Vetores das Diagonais
//-----------------------------------------------------
V1  = Vector.ByCoordinates( d2 ,  d2 , -alt);
V2  = Vector.ByCoordinates(-d2 ,  d2 , -alt);
V3  = Vector.ByCoordinates(-d2 , -d2 , -alt);
V4  = Vector.ByCoordinates( d2 , -d2 , -alt);
LVE = [V1,V2,V3,V4];
DVE = V1.Length;
//-----------------------------------------------------
// Posicionamento dos Pontos
//-----------------------------------------------------
coi = 0..( d1*q )..d1;
cos = List.DropItems      ( coi , 1 ) - d2;
phi = Point.ByCoordinates ( coi<1> , coi , 0   );
phs = Point.ByCoordinates ( cos<1> , cos , alt );
pvi = List.Transpose      ( phi                );
pvs = List.Transpose      ( phs                );
//-----------------------------------------------------
// Barras do Banzo Inferior
//-----------------------------------------------------
BHI = Line.ByStartPointEndPoint(phi[i], phi[i+1]);
BVI = Line.ByStartPointEndPoint(pvi[i], pvi[i+1]);
//-----------------------------------------------------
// Barras do Banzo Superior
//-----------------------------------------------------
BHS = Line.ByStartPointEndPoint(phs[k], phs[k+1]);
BVS = Line.ByStartPointEndPoint(pvs[k], pvs[k+1]);
//-----------------------------------------------------
// Barras das Diagonais
//-----------------------------------------------------
DIA = Line.ByStartPointDirectionLength(phs,LVE<1>,DVE);
//-----------------------------------------------------
// Extração de resultados utilizando Dicionário
//-----------------------------------------------------
Key = [ "Apoios", "QuaMod" , "PntosH" ];
Val = [  ap     ,  q       ,  phi     ];
DIC = Dictionary.ByKeysValues ( Key , Val );
# ----------------------------------------
define_a_posição_dos_apóios = CodeBlock(Dados=treliça_espacial_equilátera.DIC)
# ---------- define_a_posição_dos_apóios.designscript (17 lines) ----------
Dados;
q   = Dados["QuaMod"];
ap  = Dados["Apoios"];
phi = Dados["PntosH"];
//-----------------------------------------
// Índices de marcação
//-----------------------------------------
r   = 0.25;
i   =   ap;
j   = -1-i;
k   =  q-i;
//-----------------------------------------
// Pontos dos Apóios
//-----------------------------------------
LAP = [ phi[i][i], phi[j][i],
        phi[i][k], phi[j][k] ];
AP1 = Circle.ByCenterPointRadius( LAP , r );
# ----------------------------------------
