# Dynamo graph Eixos_Modulados.dyn (Dynamo 3.0.3.7597)

# group: Cria Eixos Modulados e cotados
# Prof: José Luis Menegoitto
# Escola Politécnica da UFRJ
views = Views("Térreo")
quantidade_módulos_x = IntegerSlider(10, range=2..30 step 1)
dimensão_módulo_básico_x = DoubleSlider(1.5, range=1..6 step 0.25)
razão_adit_subst_mod_x = DoubleSlider(0.5, range=0.25..0.75 step 0.25)
valor_modular_em_x = IntegerSlider(5, range=1..5 step 1)
valor_modular_em_x_2 = IntegerSlider(10, range=10..30 step 2)
eixos_modulados = CodeBlock(vis=views, qx=quantidade_módulos_x, dx=dimensão_módulo_básico_x, rx=razão_adit_subst_mod_x, mx=valor_modular_em_x, sy=valor_modular_em_x_2)
# ---------- eixos_modulados.designscript (26 lines) ----------
vis;
qx;
dx;
rx;
mx;
sy;
PAR = "Name";
//--------------------------------------------------
ix  = -qx/2..qx/2;
dex = dx * rx;
Cx  = dx * ix + (ix%mx ? dex : 0);
//--------------------------------------------------
PX1 = Point.ByCoordinates ( Cx ,  sy     , 0 );
PX2 = PX1.Translate       ( 0  , -sy*2.0 , 0 );
PX3 = PX1.Translate       ( 0  , -sy*2.1 , 0 );
//--------------------------------------------------
// Colocação de eixos com cotas
//--------------------------------------------------
nume = List.IndexOf(ix, ix)+1;
nome = ""+nume;
eix  = Grid.ByStartPointEndPoint ( PX1 , PX2 );
eix.SetParameterByName           ( PAR , nome);
//--------------------------------------------------
ldi  = Line.ByStartPointEndPoint ( PX3[0], PX3[-1]);
ref  = eix.Curve;
dim  = Dimension.ByElements ( vis,eix,ldi,"","" );
# ----------------------------------------
