# Dynamo graph Mover_Simbolo_Vista.dyn (Dynamo 3.0.3.7597)

# group: Modifica Posição Símbolos de Vista
# Prof. José Luis Menegotto
# Escola Politécnica da UFRJ
abrir_espaço = BoolSelector(true)
categories = Categories("OST_Elev")
all_elements_of_category = ElementsOfCategory(Category=categories)
ajustar_marcas_de_vistas = CodeBlock(abre=abrir_espaço, simb=all_elements_of_category)
# ---------- ajustar_marcas_de_vistas.designscript (13 lines) ----------
abre;
simb;
n  = abre? 1 : -1;
LV = [
      Vector.ByCoordinates(    0 , n*1, 0 ),
      Vector.ByCoordinates( n* 1,    0, 0 ),
      Vector.ByCoordinates( n*-1,    0, 0 ),
      Vector.ByCoordinates(    0, n*-1, 0 )
     ];
//----------------------------------------
tra = Transaction.Start ( simb );
tra.MoveByVector( LV  );
Transaction.End ( tra );
# ----------------------------------------
