# Dynamo graph PPE_Aula06b.dyn (Dynamo 2.18.1.5096)

# group: Função para marcação de treliças
# Escola Politécnica UFRJ.
# Prof. José Luis Menegotto
vão_total_da_treliça = DoubleSlider(10.75, range=10..20 step 0.25)
quantidade_de_módulos = DoubleSlider(24, range=4..40 step 4)
angulo = DoubleSlider(15, range=0..15 step 5)
altura_inicial_entre_banzos = DoubleSlider(1, range=1..2 step 0.1)
inverter_as_aguas = BoolSelector(false)
banzos_paralelos = BoolSelector(true)
treliças_pratt_0_howe_1 = DoubleSlider(1, range=0..1 step 1)
marcação_das_barras_de_treliças = CodeBlock(vao=vão_total_da_treliça, qmo=quantidade_de_módulos, ang=angulo, alt=altura_inicial_entre_banzos, inv=inverter_as_aguas, par=banzos_paralelos, tre=treliças_pratt_0_howe_1)
# ---------- marcação_das_barras_de_treliças.designscript (49 lines) ----------
vao;
qmo;
ang;
alt;
inv;
par;
tre;
//-----------------------------------------------------
vx   = vao/2;
qme  = qmo/2;
inc  = Math.Tan( ang );
//-----------------------------------------------------
// Formação das listas de índices
//-----------------------------------------------------
x    = vx..-vx..#qmo+1;
i    = List.Flatten([ qme..0   , 1..qme] ,1);
j    = List.Flatten([ 0..qme-1 , qme..0] ,1);
indi = inv== 0 ? i : j;
vzi  = x   * inc;
vzs  = vzi + alt;
//-----------------------------------------------------
albi = par== 0 ? 0         : vzi[indi];
albs = par== 0 ? vzs[indi] : vzs[indi];
//-----------------------------------------------------
// Pontos do Banzo inferior e superior
//-----------------------------------------------------
PTI  = Point.ByCoordinates( x , 0 , albi );
PTS  = Point.ByCoordinates( x , 0 , albs );
//-----------------------------------------------------
// Indices completo ic e as duas metades i1 e 12
//-----------------------------------------------------
ic   = 0  ..qmo-1;
i1   = 0  ..qme-1;
i2   = qme..qmo-1;
//-----------------------------------------------------
// Os indices j e k são invertidos caso o sistema seja
// Pratt ou Howe
//-----------------------------------------------------
k    = tre==0?  i1 : i2;
l    = tre==0?  i2 : i1;
//-----------------------------------------------------
// Barras de Montantes, Banzo Inferior, Banzo Superior
// Diagonais esquerdas e Diagonais direitas
//-----------------------------------------------------
BMO  = Line.ByStartPointEndPoint ( PTI     , PTS       );
BBI  = Line.ByStartPointEndPoint ( PTI[ic] , PTI[ic+1] );
BBS  = Line.ByStartPointEndPoint ( PTS[ic] , PTS[ic+1] );
BDE  = Line.ByStartPointEndPoint ( PTS[k]  , PTI[k+1]  );
BDD  = Line.ByStartPointEndPoint ( PTI[l]  , PTS[l+1]  );
# ----------------------------------------
