# Dynamo graph PPE_Aula_08b.dyn (Dynamo 3.0.3.7597)

# group: Distribuição de linhas e pontos entre paredes
# Prof: José Luis Menegotto
# Escola Politécnica da UFRJ
categories = Categories("OST_Walls")
all_elements_of_category = ElementsOfCategory(Category=categories)
dimensão_x = DoubleSlider(2, range=1..10 step 0.25)
dimensão_y = DoubleSlider(1.75, range=1..10 step 0.25)
ponto_referência_0_5_ponto_médio = DoubleSlider(0.5, range=0..1 step 0.05)
inverter_as_normais = BoolSelector(true)
lança_linhas_entre_paredes = CodeBlock(Par=all_elements_of_category, dx=dimensão_x, dy=dimensão_y, pr=ponto_referência_0_5_ponto_médio, re=inverter_as_normais)
# ---------- lança_linhas_entre_paredes.designscript (26 lines) ----------
Par;
dx;
dy;
pr;
re;
//--------------------------------------------------
i   = 0..1;
o   = i+2;
EiP = Par[i].GetLocation( );
EiO = Par[o].GetLocation( );
Dir = EiP.NormalAtParameter ( pr );
//--------------------------------------------------
// Pt de referencia, pontos e projeções
//--------------------------------------------------
Ldi = [ dx  , dy ];
LVn = [re?Dir:Dir.Reverse(),re?Dir.Reverse():Dir];
//--------------------------------------------------
Pme = EiP.PointAtParameter ( pr );
Lpo = EiP.PointsAtSegmentLengthFromPoint(Pme, Ldi);
Ppr = Lpo.Project  ( EiO , LVn<1> );
Lpr = List.Flatten ( Ppr , 1      );
//-------------------------------------------------
// Linhas e Pontos
//-------------------------------------------------
Lin = Line.ByStartPointEndPoint( Lpo , Lpr[o] );
Pin = Line.IntersectAll( Lin[0]<1>, Lin[1]<2> );
# ----------------------------------------

watch = Watch()  # unwired: arg0
