# Dynamo custom node MET_Analitica_Viga.dyf (Dynamo 2.18.1.5096)
# category: MET
# Cria uma viga analítica

Curva_Viga = Input(Curva_Viga: var[]..[])
structural_roles = StructuralRoleComboBox("Beam")
define_viga_analítica = CodeBlock(Curva=Curva_Viga, Role=structural_roles) { Curva; Role; MA = AnalyticalMember.ByCurve ( Curva ); AnalyticalMember.SetStructuralRole ( [ MA ] , Role ); }
Viga_Analítica = Output(define_viga_analítica.out3)
