# Dynamo graph MET_Coloca_Conexao_ColVig.dyn (Dynamo 2.18.1.5096)

# group: Coloca Placas de Base, Mísulas e Cumeeiras em Pórtico Tipo 1
# Algoritmo para Colocação de Ligações de Aço em Pórticos de galpão metálica: Curso de Especialização de Estruturas de Aço - Escola Politécnica - UFRJ.
# Disciplina:  ETM602 - Desenho, Montagem e Fabricação (CAD/CAM/BIM).
# Prof. José Luis Menegotto.
selectStructureData = SelectStructureData()  # 4 picked in the model
structuralDataTypes = StructuralDataTypes("Vigas W Gerdau | W250X32.7")
structuralDataTypes_2 = StructuralDataTypes("Pilares HP Gerdau | HP310X79")
conexão_utilizada = ConnectionTypes("Apex haunch | Apex haunch")
conexão_utilizada_2 = ConnectionTypes("Knee of frame bolted, with haunch | MIS_01")
conexão_utilizada_3 = ConnectionTypes("Base plate cut | Base plate cut")
coloca_conexão_coluna_viga = CodeBlock(Elemn=selectStructureData, TpVigas=structuralDataTypes.typeName, TpPilar=structuralDataTypes_2.typeName, Top=conexão_utilizada, Mis=conexão_utilizada_2, Pla=conexão_utilizada_3)
# ---------- coloca_conexão_coluna_viga.designscript (29 lines) ----------
Elemn;
Nodos;
TpVigas;
TpPilar;
Top;
Mis;
Pla;
Nodos = ConnectionNode.FromStructure  ( Elemn     );
Grup1 = ConnectionNode.SubNodesOfSize ( Nodos , 1 );
Grup2 = ConnectionNode.SubNodesOfSize ( Nodos , 2 );
//----------------------------------------------------------------
// Cumeeiras
//----------------------------------------------------------------
F_T0  = Filter.BySectionType ( Grup2 , 0 , TpVigas )["accepted"];
F_T1  = Filter.BySectionType ( Grup2 , 1 , TpVigas )["accepted"];
F_T   = List.SetIntersection ( F_T0 , F_T1 );
Topos = Connection.ByType    ( F_T  , [0 , 1] , Top);
//----------------------------------------------------------------
// Mísulas
//----------------------------------------------------------------
F_M0  = Filter.BySectionType ( Grup2 , 0 , TpPilar )["accepted"];
F_M1  = Filter.BySectionType ( Grup2 , 1 , TpVigas )["accepted"];
F_M   = List.SetIntersection ( F_M0  , F_M1 );
Misul = Connection.ByType    ( F_M   , [0 , 1] , Mis);
//----------------------------------------------------------------
// Placa de Base
//----------------------------------------------------------------
F_P   = Filter.BySectionType ( Grup1 , 0 , TpPilar )["accepted"];
Placa = Connection.ByType    ( F_P   , 0 , Pla );
# ----------------------------------------
