# Dynamo graph MET_Montar_Portico.dyn (Dynamo 2.18.1.5096)

# group: Marcação de Planos Horizontais (Levels) e do Pórtico
# Algoritmo para montar Pórticos Tipo 1 para galpão metálico.
# Curso de Especialização de Estruturas de Aço - Escola Politécnica - UFRJ.
# Disciplina:  ETM602 - Desenho, Montagem e Fabricação (CAD/CAM/BIM).
# Prof. José Luis Menegotto.
categories = Categories("OST_Levels")
all_elements_of_category = ElementsOfCategory(Category=categories)
cota_beiral = DoubleSlider(4.25, range=3..5 step 0.25)
cota_fundação = DoubleSlider(-1.75, range=-2..-1 step 0.25)
vão_livre = DoubleSlider(18, range=5..45 step 1)
angulo_de_inclinação = DoubleSlider(7, range=0..45 step 1)
distância_entre_terças = DoubleSlider(1.2, range=1..1.5 step 0.05)
define_pontos = CodeBlock(Planos=all_elements_of_category, bei=cota_beiral, fun=cota_fundação, vl=vão_livre, an=angulo_de_inclinação, dt=distância_entre_terças)
# ---------- define_pontos.designscript (34 lines) ----------
Planos;
bei;
ter = 0;
fun;
vl;
an;
dt;
//-------------------------------------------------
nomes = ["Fundação","Térreo","Beiral","Cumeeira"];
altur = [ fun      ,  ter   ,  bei   ,   bei+dz ];
Planos.SetParameterByName ( "Name"      , nomes );
Planos.SetParameterByName ( "Elevation" , altur );
//-------------------------------------------------
dz = Math.Tan(an) * vl/2;
x  = [0   ,  0  ,   0.5  ,   1 ,  1  ] * vl;
z  = [fun , bei , bei+dz , bei , fun ];
i  = [1, 2];
j  = i+1;
k  = [0 , 4];
l  = [1 , 3];
//-------------------------------------------------
PO = Point.ByCoordinates          ( x , 0 , z );
// Colunas e Vigas --------------------------------
CO = Line.ByStartPointEndPoint   ( PO[k] , PO[l] );
VI = Line.ByStartPointEndPoint   ( PO[i] , PO[j] );
// MetSec Fachada ---------------------------------
rf = CO.PointAtParameter               ( 0.5     );
FA = CO.PointsAtSegmentLengthFromPoint ( rf , dt );
// Terças -----------------------------------------
rv = VI.PointAtParameter               ( 0.5     );
TE = VI.PointsAtSegmentLengthFromPoint ( rv , dt );
Planos;
CO;
VI;
# ----------------------------------------

# group: Coloca Vigas e Colunas. (Devem ser carregadas as familias que serão utilizadas)
# Algoritmo para montar Pórticos Tipo 1 para galpão metálico.
# Curso de Especialização de Estruturas de Aço - Escola Politécnica - UFRJ.
# Disciplina:  ETM602 - Desenho, Montagem e Fabricação (CAD/CAM/BIM).
# Prof. José Luis Menegotto.
structural_column_types = StructuralColumnTypes("No structural column types available.")
structural_framing_types = StructuralFramingTypes("No structural framing types available.")
coloca_as_vigas_primárias_e = CodeBlock(AN=define_pontos.out25, CO=define_pontos.out26, VI=define_pontos.out27, TC=structural_column_types, TV=structural_framing_types)  # "Coloca as Vigas Primárias e Colunas"
# ---------- coloca_as_vigas_primárias_e.designscript (29 lines) ----------
AN;
CO;
VI;
TC;
TV;
//--------------------------------------------------------
// Coloca Instâncias de Colunas e Vigas
//--------------------------------------------------------
IC  = StructuralFraming.ColumnByCurve ( CO , AN[0] , TC );
IV  = StructuralFraming.BeamByCurve   ( VI , AN[1] , TV );
//--------------------------------------------------------
// Dados de Tipo de Viga e Coluna para calculo posterior
//--------------------------------------------------------
LT  = [TC      , TV       ];
LP  = ["Width" , "Height" ];
LT<1>.GetParameterValueByName ( LP ) * 10;
//--------------------------------------------------------
// Definição de alinhamento e posicionamento
//--------------------------------------------------------
LI  = [IC                       , IV                ];
LV  = ["Cross-Section Rotation" , "z Justification" ];
VA  = [     90                  ,  2                ];
LI.SetParameterByName ( LV , VA);
//--------------------------------------------------------
// Define Dicionário de Dados
//--------------------------------------------------------
Key = ["TipoC", "TipoV", "Colunas" , "Vigas" ];
Val = [ TC    ,  TV    ,  IC       , IV      ];
Dic = Dictionary.ByKeysValues( Key , Val );
# ----------------------------------------

# group: Calcula o Peso do Pórtico
# Algoritmo para montar Pórticos Tipo 1 para galpão metálico.
# Curso de Especialização de Estruturas de Aço - Escola Politécnica - UFRJ.
# Disciplina:  ETM602 - Desenho, Montagem e Fabricação (CAD/CAM/BIM).
# Prof. José Luis Menegotto.
calcular_peso = CodeBlock(Dic=coloca_as_vigas_primárias_e.Dic)
# ---------- calcular_peso.designscript (16 lines) ----------
Dic;
//Instâncias ------------------------------------------------
Col = Dic["Colunas"];
Vig = Dic["Vigas"];
//Tipos -----------------------------------------------------
TPC = Dic["TipoC"];
TPV = Dic["TipoV"];
LTP = [TPC , TPV ];
//-----------------------------------------------------------
// Cálculo do peso
//-----------------------------------------------------------
KGT = LTP.GetParameterValueByName ("Nominal Weight" );
KGC = Col.GetParameterValueByName ("Comprimento" )*KGT[0]<1>;
KGV = Vig.GetParameterValueByName ("Length"      )*KGT[1]<1>;
KGR = List.Flatten ( [KGC, KGV] , 1) / 1000;
PES = Math.Round ( Math.Sum  ( KGR ), 2) + " Toneladas";
# ----------------------------------------
peso = Watch(calcular_peso.PES)

# group: Define os elementos analíticos
# Custom Nodes com o algoritmos para definir membros analíticos.
# Curso de Especialização de Estruturas de Aço - Escola Politécnica - UFRJ.
# Disciplina:  ETM602 - Desenho, Montagem e Fabricação (CAD/CAM/BIM).
# Prof. José Luis Menegotto.
coluna_Analitica = Custom[Coluna_Analitica](Curva_Coluna=define_pontos.out19)
MET_Analitica_Viga = Custom[MET_Analitica_Viga](Curva_Viga=define_pontos.out20)
