# Dynamo graph Forma_Espiral_Ncentros.dyn (Dynamo 2.17.1.4055)

# group: Construção e uso da Espiral de n Centros
# Disciplina:              BIM I Modelagem Digital da Edificação
# Desenvolvido por: Prof. José Luis Menegotto
# Departamento de Expressão Gráfica / Escola Politécnica da UFRJ
quantidade_de_centros = DoubleSlider(8, range=1..20 step 1)
raio_do_polígono_gerador = DoubleSlider(0.27, range=0.05..1 step 0.01)
definição_de_forma_baseada_em = CodeBlock(q=quantidade_de_centros, r=raio_do_polígono_gerador)  # "Definição de forma baseada em Espirais de n centros"
# ---------- definição_de_forma_baseada_em.designscript (19 lines) ----------
q;
r;
m   = 360/q;
vz  = Vector.ZAxis();
an  = 0..360..m;
x   = Math.Cos( an ) * r;
y   = Math.Sin( an ) * r;
cen = Point.ByCoordinates( x,y,0);
lad = Point.DistanceTo (cen[0], cen[1]);
i   = 0..q-1;
j   = List.ShiftIndices(i, 1);
dt  = lad + (lad * i);
Ve  = Vector.ByTwoPoints (cen[i] , cen[j]);
sp  = Point.Translate ( cen[i] , Ve , dt);
cp  =  List.DropItems(cen,1);
pol = PolyCurve.ByPoints( cp, true);
arc = Arc.ByCenterPointStartPointSweepAngle(cen, sp, m, vz);
epa = Arc.PointAtParameter(arc, 1);
rad = Line.ByStartPointEndPoint(cen, epa);
# ----------------------------------------
