# Dynamo graph Oval4Centros.dyn (Dynamo 2.17.1.4055)

diagonal_x = DoubleSlider(2.2, range=1..20 step 0.1)
diagonal_y = DoubleSlider(1, range=1..20 step 0.1)
oval_de_4_centros = CodeBlock(Dx=diagonal_x, Dy=diagonal_y)
# ---------- oval_de_4_centros.designscript (16 lines) ----------
Dx;
Dy;
p1 = Point.ByCoordinates(Dx , 0  , 0);
p2 = Point.ByCoordinates(0  , Dy , 0);
p3 = Point.ByCoordinates(-Dx, 0  , 0);
p4 = Point.ByCoordinates(0  , -Dy, 0);
LP = [p1,p2,p3,p4];
LPS = List.ShiftIndices(LP, 3);
Lad = Line.ByStartPointEndPoint(LP, LPS);
Pme = Line.PointAtParameter  (Lad , 0.5);
Nor = Line.NormalAtParameter (Lad , 0.5);
Tng = Line.TangentAtParameter(Lad , 0.5);
Pms = List.ShiftIndices(Pme, 3);
O4C = Arc.ByStartPointEndPointStartTangent(Pme, Pms, Tng);
Cen = O4C.CenterPoint;
Lin = Line.ByStartPointEndPoint(Cen, Pme);
# ----------------------------------------
