# Dynamo graph Cortes.dyn (Dynamo 2.18.1.5096)

deslocar_em_x = IntegerSlider(2150, range=-5000..5000 step 50)  # graph input
deslocar_em_y = IntegerSlider(2000, range=-5000..5000 step 50)  # graph input
inferior = IntegerSlider(-2000, range=-4000..0 step 500)  # graph input
largura = IntegerSlider(4000, range=1000..10000 step 500)  # graph input
altura = IntegerSlider(5000, range=-300..5000 step 20)  # graph input
prof = IntegerSlider(2000, range=1000..9000 step 500)  # graph input
define_um_corte = CodeBlock(dx=deslocar_em_x, dy=deslocar_em_y, i=inferior, x=largura, a=altura, pc=prof)
# ---------- define_um_corte.designscript (39 lines) ----------
dx;
dy;
i;
x;
y = 0;
a;
pc;
OR = P1;
ac = (i*-1) + a;
dc = P1.DistanceTo(P2);
//----------------------------------------------
// Define a linha de corte
//----------------------------------------------
P1 = Point.ByCoordinates(  x+dx , dy , i );
P2 = Point.ByCoordinates( -x+dx , dy , i );
//----------------------------------------------
// Define plano de corte
//----------------------------------------------
VX = Vector.ByTwoPoints ( P1, P2 ).Normalized();
VY = Vector.ZAxis();
VZ = Vector.Cross ( VX , VY );
//----------------------------------------------
// Define a amplitude vertical do corte
//----------------------------------------------
C0 = Point.Origin();
C1 = Point.ByCoordinates(dc , ac , pc);
CS  = CoordinateSystem.ByOriginVectors(P1,VX,VY,VZ);
//-----------------------------------------------
// Faz a Vista Cortada
//-----------------------------------------------
nome = "Corte B";
VC = SectionView.ByCoordinateSystemMinPointMaxPoint(CS, C0, C1);
//-----------------------------------------------
// Seta os parâmetros
//-----------------------------------------------
VC.SetParameterByName("View Name"           , nome);
VC.SetParameterByName("Detail Level"        , 3);
VC.SetParameterByName("Crop Region Visible" , 0);
VC.SetParameterByName("Title on Sheet"      , nome);
# ----------------------------------------
