# Dynamo graph Tendão.dyn (Dynamo 3.3.0.6316)

# group: Cria elemento cilíndrico con formato de catenária
# Autor: Prof. José Luis Menegotto.
# Escola Politécnica da UFRJ
# Disciplinas BIM, Descomp
funções = CodeBlock()
# ---------- funções.designscript (6 lines) ----------
// x número ou lista
// a maior que 0
def Catenaria( x , a )
{
   return =  ( a * Math.Cosh(x/a)) - a;
};
# ----------------------------------------
quantidade = IntegerSlider(20, range=2..20 step 1)
fator = DoubleSlider(33, range=10..100 step 1)
raio = DoubleSlider(0.19, range=0.1..1 step 0.01)
forma_cilíndrica = CodeBlock(qx=quantidade, f=fator, r=raio)
# ---------- forma_cilíndrica.designscript (19 lines) ----------
qx;
f;
r;
//--------------------------------------------
x  = -qx..qx..#qx;
y  = Catenaria ( x , f );
//--------------------------------------------
LP = Point.ByCoordinates( x  , y    , 0 );
PO = PolyCurve.ByPoints ( LP , false    );
CV = PolyCurve.Curves   ( PO            );
P1 = CV.StartPoint;
P2 = CV.EndPoint;
Di = CV.Direction;
C1 = List.AddItemToEnd( P2[-1] , P1 );
D1 = List.AddItemToEnd( Di[-1] , Di );
GE = Circle.ByCenterPointRadiusNormal(C1,r,D1);
st = String.Replace(""+r, "0", "");
SO = Solid.ByLoft     ( GE          );
ID = "Cabo_"+qx+"_"+Math.Floor(f)+"_"+st+"_";
# ----------------------------------------
faz_o_elemento_e_define_mark = Python(IN[0]=forma_cilíndrica.SO, IN[1]=forma_cilíndrica.ID)  # CPython3
# ---------- faz_o_elemento_e_define_mark.python (70 lines) ----------
import clr
clr.AddReference('System')
clr.AddReference("RevitAPI")
clr.AddReference("RevitServices")
clr.AddReference("RevitNodes")
from System                     import DateTime
from RevitServices.Persistence  import DocumentManager
from RevitServices.Transactions import TransactionManager

import Autodesk.Revit.DB as DB

# RevitNodes – conversão Dynamo → Revit

import Revit
clr.ImportExtensions(Revit.GeometryConversion)

from System.Collections.Generic import List

doc = DocumentManager.Instance.CurrentDBDocument


geom  = IN[0] 
iden  = IN[1] 
now   = DateTime.Now
dat   = iden+now.ToString("dd/MM/yyyy_HH:mm:ss:fff")
ca    = DB.BuiltInCategory.OST_StructuralTendons
cat   = DB.Category.GetCategory(doc, ca)
catId = cat.Id


# 1) Garante que so é lista de geometrias
if isinstance(geom, list):
    geom_list = geom
else:
    geom_list = [geom]

# 2) Converte cada geometria para Revit
rev_geom_list = []
for g in geom_list:
    # Se vier elemento Revit, não tenta converter
    try:
        rg = g.ToRevitType()
    except:
        rg = None
    if rg:
        # Alguns retornam lista, outros um único objeto
        if isinstance(rg, list):
            rev_geom_list.extend(rg)
        else:
            rev_geom_list.append(rg)

# 3) Montar List[GeometryObject] para o DirectShape
geo_list = List[DB.GeometryObject]()
for g in rev_geom_list:
    geo_list.Add(g)

TransactionManager.Instance.EnsureInTransaction(doc)

# 4) Criar DirectShape
ds = DB.DirectShape.CreateElement(doc, catId)
ds.SetShape ( geo_list )

# 5) Tentar seta Marca
p = ds.LookupParameter("Mark")
if p and not p.IsReadOnly:
    p.Set(str(dat))

TransactionManager.Instance.TransactionTaskDone()

OUT = ds
# ----------------------------------------
