# Dynamo graph Tendão_Trazado.dyn (Dynamo 3.3.0.6316)

# group: Cria elemento cilíndrico para cordoalhas em vigas
# Autor: Prof. José Luis Menegotto.
# Escola Politécnica da UFRJ
# Disciplinas BIM, Descomp
marca_a_cordoalha = CodeBlock()
# ---------- marca_a_cordoalha.designscript (14 lines) ----------
def Cabo ( l , a , e , fa, fc, j)
{
    m  = 10;
    o  = l/2;
    a  = l/m;
    b  = l/(m*2);
    c  = l-a;
    d  = l-b;
    x  =  0..l..#(l*m);
    xc = -o..o..#(l*m);
    z = Altura( xc,a,fa,fc,j);
    p = Desvio( x ,z,a,b,c,d,e);
    return = p;
};
# ----------------------------------------
luz_do_vão = DoubleSlider(32.5, range=5..50 step 0.25)
altura_da_viga = DoubleSlider(2, range=1..3 step 0.25)
largura_da_viga = DoubleSlider(1, range=0.6..1 step 0.25)
ajuste_da_altura_da_cordoalha = DoubleSlider(0.825, range=0..3 step 0.025)
deslocamento_do_centro = DoubleSlider(0.01, range=0..0.05 step 0.01)
fator_de_altura = DoubleSlider(0.5, range=0.1..0.5 step 0.01)
fator_de_curvatura = DoubleSlider(0.0025, range=0..0.01 step 0.0025)
raio = DoubleSlider(0.027, range=0.005..0.03 step 0.001)
modelar = BoolSelector(false)
forma_cilíndrica = CodeBlock(l=luz_do_vão, a=altura_da_viga, e=largura_da_viga, j=ajuste_da_altura_da_cordoalha, d=deslocamento_do_centro, fa=fator_de_altura, fc=fator_de_curvatura, r=raio, OK=modelar)
# ---------- forma_cilíndrica.designscript (24 lines) ----------
l;
a;
e;
j;
d;
fa;
fc;
r;
OK;
//--------------------------------------------
VI  = Viga ( l , a , e              );
LP  = Cabo ( l , a , d , fa , fc , j);
//--------------------------------------------
PO = PolyCurve.ByPoints ( LP , false    );
CV = PolyCurve.Curves   ( PO            );
P1 = CV.StartPoint;
P2 = CV.EndPoint;
Di = CV.Direction;
C1 = List.AddItemToEnd ( P2[-1] , P1 );
D1 = List.AddItemToEnd ( Di[-1] , Di );
GE = Circle.ByCenterPointRadiusNormal(C1,r,D1);
SO = Solid.ByLoft      ( GE            );
ID = "Tensor-"+l+"-"+fa+"-"+fc+"-"+d;
OK;
# ----------------------------------------
faz_o_elemento = Python(IN[0]=forma_cilíndrica.out19, IN[1]=forma_cilíndrica.out20, IN[2]=forma_cilíndrica.out21)  # CPython3
# ---------- faz_o_elemento.python (66 lines) ----------
import clr
import Revit
import Autodesk.Revit.DB as DB

clr.AddReference('System')
clr.AddReference("RevitAPI")
clr.AddReference("RevitServices")
clr.AddReference("RevitNodes")
from System                     import DateTime
from RevitServices.Persistence  import DocumentManager
from RevitServices.Transactions import TransactionManager

clr.ImportExtensions(Revit.GeometryConversion)

from System.Collections.Generic import List

doc = DocumentManager.Instance.CurrentDBDocument

geom  = IN[0] 
iden  = IN[1] 
dese  = IN[2]

now   = DateTime.Now
dat   = now.ToString("dd/MM/yyyy_HH:mm:ss:fff")
ca    = DB.BuiltInCategory.OST_StructuralTendons
cat   = DB.Category.GetCategory(doc, ca)
catId = cat.Id

if isinstance(geom, list):
    geom_list = geom
else:
    geom_list = [geom]

rev_geom_list = []
for g in geom_list:
    try:
        rg = g.ToRevitType()
    except:
        rg = None
    if rg:
        if isinstance(rg, list):
            rev_geom_list.extend(rg)
        else:
            rev_geom_list.append(rg)

geo_list = List[DB.GeometryObject]()
for g in rev_geom_list:
    geo_list.Add(g)

if dese == True:
    TransactionManager.Instance.EnsureInTransaction(doc)
    forma = DB.DirectShape.CreateElement(doc, catId)
    forma.SetShape(geo_list)
    marca = forma.LookupParameter("Mark")
    idmar = iden.replace("0", "").replace(".", "")

    if marca and not marca.IsReadOnly:
        marca.Set(str( idmar+"_"+dat ))
    comme = forma.LookupParameter("Comments")
    if comme and not comme.IsReadOnly:
        comme.Set("Volume:" + str( round(geom.Volume, 2)))
    TransactionManager.Instance.TransactionTaskDone()
else:
    forma = ""

OUT = forma
# ----------------------------------------
marca_a_viga = CodeBlock()
# ---------- marca_a_viga.designscript (9 lines) ----------
def Viga ( l , a , e )
{
    lx = [0,l, l, 0];
    ly = [0,0, 0, 0];
    lz = [0,0,-a,-a];
    po = Point.ByCoordinates(lx,ly,lz);
    vi = PolyCurve.ByPoints (po, true);
    return = vi;
};
# ----------------------------------------
calcula_deslocamento_em_planta = CodeBlock()
# ---------- calcula_deslocamento_em_planta.designscript (7 lines) ----------
def Desvio( x,z,a,b,c,d,e )
{
  y = (x >= 0 && x <= a) ?  0 :
      (x >  a && x <  b) ? -e :
      (x >  b && x <  c) ? -e : 0;
  return = Point.ByCoordinates(x,y,z);
};
# ----------------------------------------
altura_dos_pontos = CodeBlock()
# ---------- altura_dos_pontos.designscript (6 lines) ----------
def Altura( x , a , fa, fc , j)
{
  de = ( (fa/x) / fc );
  z  = Math.Cosh( x / de );
  return = z-(a*j);
};
# ----------------------------------------
