# Dynamo graph Hiperboloide_Midi.dyn (Dynamo 2.17.1.4055)

revit_uia = Python()  # CPython3
# ---------- revit_uia.python (20 lines) ----------
import clr
import Revit

clr.AddReference("ProtoGeometry")
clr.AddReference("RevitAPI")
clr.AddReference("RevitAPIUI")
clr.AddReference("RevitServices")
clr.AddReference("RevitNodes")

from Autodesk.DesignScript.Geometry import *
from Autodesk.Revit.DB import *
from RevitServices.Persistence import DocumentManager


#dad = IN[0]

doc = DocumentManager.Instance.CurrentDBDocument
uia = DocumentManager.Instance.CurrentUIApplication

OUT = uia
# ----------------------------------------
code_block = CodeBlock { 0; }
MIDI_Ativar = Musica_2020.Musica_2020.MIDI_Ativar(n=code_block)
zero = TimeSpan.Zero()
now = DateTime.Now()
timeOfDay = DateTime.TimeOfDay(dateTime=now)
add = TimeSpan.Add(timeSpan1=zero, timeSpan2=timeOfDay)
densidade = IntegerSlider(15, range=15..30 step 5)
constroi_parabolóide = CodeBlock(tempo=add, div=densidade)
# ---------- constroi_parabolóide.designscript (40 lines) ----------
tempo;
div;
//---------------------------------------------------
// Converte em string o Tempo Atual e separa miliseg.
//---------------------------------------------------
max =  25;
apo =   5;
fal =  15;
rai =   1;
mx  = max/2;
txt = "Autodesk.DesignScript.Geometry.Point";
frz = Math.Random(max) * 10;
vz  = Vector.ZAxis();
seg = String.Substring ( tempo+"" , 6 , 2);
mil = String.Substring ( tempo+"" , 9 , 5);
si1 = String.ToNumber  ( seg ) % 60;
si2 = String.ToNumber  ( mil ) % 60;
//---------------------------------------------------------------------
ang = 180 - (30 * (2 + si2%3));
a   = 0..360..div;
b   = a<1> + [ang, -ang];
q   = List.Count( a )-1;
rai = (si2+2);
alt = (si2+1)/10;
xa  = rai * Math.Cos ( a );
ya  = rai * Math.Sin ( a );
xb  = rai * Math.Cos ( b );
yb  = rai * Math.Sin ( b );
pa  = Point.ByCoordinates ( xa , ya , alt );
pb  = Point.ByCoordinates ( xb , yb ,  0  );
lin = Transpose( Line.ByStartPointEndPoint( pb , pa));

l1  = List.Flatten( lin , 1);
pin = Geometry.Intersect ( l1<1> , l1 );
pi1 = List.Flatten ( pin , 2 );
pi2 = DSCore.Object.Type(pi1)+"" == txt ? pi1 : null;

pon = List.Clean( pi2 , false);
cox = pon.X + pon.Y;
coz = pon.Z;
# ----------------------------------------
tocar = CodeBlock(app=revit_uia, midi=MIDI_Ativar, max=constroi_parabolóide.out2, si1=constroi_parabolóide.out12, si2=constroi_parabolóide.out13, cox=constroi_parabolóide.out31, coy=constroi_parabolóide.out32)
# ---------- tocar.designscript (48 lines) ----------
app;
midi;
max;
si1;
si2;
cox;
coy;
//-------------------------------------------------------------------------
// Listas iniciais de escalas e duração
//-------------------------------------------------------------------------
andam = 1000 * (max+1) * 1;
bra   = andam / Math.Pow( max+1 , 1.55);
es1   = 20..80..(3.55 + si1%4);
es2   = List.Shuffle(es1);
es3   = List.Shuffle(es2);
rit   = 0.10..0.5..0.050;
dur   = rit * bra;
//-------------------------------------------------------------------------
// Se aumentar dur, aumentar o período para completar ciclo
//-------------------------------------------------------------------------
m     = Count ( es1 )-1;
n     = Count ( es2 )-1;
o     = Count ( es3 )-1;
r     = Count ( rit )-1;
i     = List.IndexOf(cox , cox)%m;
j     = List.IndexOf(coy , coy)%n;
k     = List.IndexOf(coy , coy)%o;
l     = List.IndexOf(cox , cox)%r;
f1    = 36 + (si1%6);
f2    = f1+12;
f3    = f1;
s1    = es1[i];
s2    = es1[i] + si2%4;
s3    = es1[i] + si2%4;
d1    = dur[l];
v1    =  9;
v2    =  9;
v3    =  si1%2==0 ? 9 : 9;
fd    =  1;
//-------------------------------------------------------------------------
qp    = List.Count( s1 );
gir   = 0..360..#qp;
az    = si1%2==0 ? gir       :  -gir;
al    = si1%2==0 ? 90..0..#qp : 90..0..#qp;
//-------------------------------------------------------------------------
// Tocar
//-------------------------------------------------------------------------
Musica_2020.Tocar_VozesLC3 (app,midi,v1,v2,v3,f1,f2,f3,s1,s2,s3,d1,az,al,1,60, 2/2);
# ----------------------------------------
watch = Watch(tocar.si2)
watch_2 = Watch(tocar.es1)
watch_3 = Watch(tocar.f2)
watch_4 = Watch(tocar.al)
angulo_giro = IntegerSlider(45, range=0..150 step 15)
