# Dynamo graph Mandala_Midi.dyn (Dynamo 2.17.1.4055)

zero = TimeSpan.Zero()
now = DateTime.Now()
timeOfDay = DateTime.TimeOfDay(dateTime=now)
add = TimeSpan.Add(timeSpan1=zero, timeSpan2=timeOfDay)
revit_uia = Python(IN[0]=add)  # CPython3
# ---------- revit_uia.python (20 lines) ----------
import clr
import Revit

clr.AddReference("ProtoGeometry")
clr.AddReference("RevitAPI")
clr.AddReference("RevitAPIUI")
clr.AddReference("RevitServices")
clr.AddReference("RevitNodes")

from Autodesk.DesignScript.Geometry import *
from Autodesk.Revit.DB import *
from RevitServices.Persistence import DocumentManager


dad = IN[0]

doc = DocumentManager.Instance.CurrentDBDocument
uia = DocumentManager.Instance.CurrentUIApplication

OUT = uia
# ----------------------------------------
code_block = CodeBlock { 0; }
MIDI_Ativar = Musica_2020.Musica_2020.MIDI_Ativar(n=code_block)
toca_0_ou_1 = IntegerSlider(1, range=0..1 step 1)
instrumentos_1_a_128 = IntegerSlider(11, range=0..128 step 1)
toca_estrutura_geométrica = CodeBlock(rvuia=revit_uia, tempo=add, midi=MIDI_Ativar, toca=toca_0_ou_1, inst=instrumentos_1_a_128)
# ---------- toca_estrutura_geométrica.designscript (31 lines) ----------
rvuia;
tempo;
midi;
toca;
inst;
//---------------------------------------------------------
// Converte em string o Tempo Atual e separa segs e mils
// Configurar o período compatível com a duração
//---------------------------------------------------------
segu = String.Substring ( tempo+"" , 6 , 2);
mili = String.Substring ( tempo+"" , 9 , 3);
segs = 0..String.ToNumber(segu)/2;
mils = 0..String.ToNumber(mili);
a    = 0..#60..(60 + mils[-1]);
x    = mils * Math.Cos ( a );
y    = mils * Math.Sin ( a );
Pt   = Point.ByCoordinates( x , y , 0);
no   = Math.Abs(Math.Floor( x )) + 55;
//---------------------------------------------------------
// se aumenta a du deve aumentar o período para que possa
// completar o ciclo
//---------------------------------------------------------
du  = 50;
di  = 127;
mo  = [6 , 4 , 3 ];
dur = no%mo[0]? du :no%mo[1]? du/2 :no%mo[2]? du/5 : du/10;
din = no%mo[0]? di :no%mo[1]? di/2 :no%mo[2]? di/5 : di/5;
//---------------------------------------------------------
// Tocar --------------------------------------------------
//---------------------------------------------------------
Musica_2020.Tocar_Nota( midi, no, dur, din, 1, inst+1, toca);
# ----------------------------------------
