# Dynamo graph Torre.dyn (Dynamo 2.17.1.4055)

# group: Exemplo Coordenadas Cilíndricas
# Desenvolvido como material didático para a Disciplina BIM;
# Prof: José Luis Menegotto  POLI/UFRJ
# O exemplo pode ser modificado para expandir as possibilidades do formato com módulo m = 6 por exemplo.
# Para que as barras verticais sejam iguais às horizontais deve ser ajustado o valor de altura utilizando um condicional
# O aluno pode experimentar utilizando o valor ra definido no condicional  e%2==0 ? r : r*1.5
# ao inves de r na definilão do pontos Point.ByCylindricalCoordinates ( cs , a<1> , al ,  r )
# Essa modificação expandirá ainda mais as possibilidades formais.
raio = IntegerSlider(1, range=1..20 step 1)
quantidade_de_módulos_verticais = IntegerSlider(21, range=1..100 step 1)
torre_equilátera = CodeBlock(r=raio, q=quantidade_de_módulos_verticais)
# ---------- torre_equilátera.designscript (24 lines) ----------
r;
q;
e    = 0..q;
m    = 3;

//Condicional de variação do raio ------------------------------------------
ra   = e%2==0 ? r : r*1.5;

//Definição dos pontos -----------------------------------------------------
cs   = CoordinateSystem.Identity();
a    = 0..360..(360/m);
al   = e * (r * Math.Sqrt(3));
po   = Point.ByCylindricalCoordinates ( cs , a<1> , al , r );
i    = 0..m-1;

//Barras Horizontais e transposição ----------------------------------------
bah  = Line.ByStartPointEndPoint      ( po[i] , po[i+1]    );
bav  = Transpose( bah );

//Barras verticais e Diagonais ---------------------------------------------
j    = 0..List.Count(bav)-2;
BarV = Line.ByStartPointEndPoint( bav[j].StartPoint , bav[j+1].StartPoint );
Dia1 = Line.ByStartPointEndPoint( bav[j].StartPoint , bav[j+1].EndPoint   );
Dia2 = Line.ByStartPointEndPoint( bav[j].EndPoint   , bav[j+1].StartPoint );
# ----------------------------------------
