# Dynamo graph Torre2.dyn (Dynamo 2.18.1.5096)

# group: Exemplo Coordenadas Cilíndricas
# Desenvolvido como material didático para a Disciplina BIM;
# Prof: José Luis Menegotto  POLI/UFRJ
# O exemplo pode ser modificado para expandir as possibilidades do formato com módulo m = 6 por exemplo.
# Para que as barras verticais sejam iguais às horizontais deve ser ajustado o valor de altura utilizando um condicional
# O aluno pode experimentar utilizando o valor ra definido no condicional  e%2==0 ? r : r*1.5
# ao inves de r na definilão do pontos Point.ByCylindricalCoordinates ( cs , a<1> , al ,  r )
# Essa modificação expandirá ainda mais as possibilidades formais.
altura_total_da_torre = IntegerSlider(60, range=20..60 step 1)
altura_modulo_da_torre = DoubleSlider(6, range=4..6 step 0.25)
raio_da_base = DoubleSlider(10, range=5..10 step 0.25)
quantidade_de_lados = IntegerSlider(3, range=3..7 step 1)
fator_inclinação = IntegerSlider(13, range=3..19 step 1)
structural_framing_types = StructuralFramingTypes("No structural framing types available.")
torre_poligonal_equilátera = CodeBlock(att=altura_total_da_torre, amt=altura_modulo_da_torre, rai=raio_da_base, lad=quantidade_de_lados, fic=fator_inclinação, tbh=structural_framing_types)
# ---------- torre_poligonal_equilátera.designscript (54 lines) ----------
att;
amt;
rai;
lad;
fic;
tbh;

qmo = Math.Floor(att / amt);
v   = 0..qmo;
i   = 0..lad-1;

altura = 0..(amt*qmo)..amt;
Niveis = Level.ByElevationAndName( altura , "Torre_Niv_ " + v);
Vistas = FloorPlanView.ByLevel   ( Niveis);
//--------------------------------------------------------------------------
//  Variação do raio
//--------------------------------------------------------------------------
vr   = 1 / (v+1);
rf   = rai*vr;
//--------------------------------------------------------------------------
//  Definição dos pontos
//--------------------------------------------------------------------------
csi   = CoordinateSystem.Identity();
ang   = 0..360..(360/lad);
alt   = altura * (rai * Math.Sqrt(3));
//--------------------------------------------------------------------------
//  Pontos do polígono regular da torre
//--------------------------------------------------------------------------
po   = Point.ByCylindricalCoordinates ( csi , ang<1> , altura , rf );
//--------------------------------------------------------------------------
//  Barras Horizontais e transposição
//--------------------------------------------------------------------------
BarH = Line.ByStartPointEndPoint      ( po[i] , po[i+1]    );
//--------------------------------------------------------------------------
//  Barras verticais
//--------------------------------------------------------------------------
bav  = Transpose( BarH );
j    = 0..List.Count(bav)-2;
BarV = Line.ByStartPointEndPoint( bav[j].StartPoint , bav[j+1].StartPoint );
//--------------------------------------------------------------------------
//  Barras Diagonais
//--------------------------------------------------------------------------
Dia1 = Line.ByStartPointEndPoint( bav[j].StartPoint , bav[j+1].EndPoint   );
Dia2 = Line.ByStartPointEndPoint( bav[j].EndPoint   , bav[j+1].StartPoint );
//--------------------------------------------------------------------------
//Colocação das barras horizontais
//--------------------------------------------------------------------------
//BHO = StructuralFraming.BeamByCurve(BarH, Niveis, tbh);
//--------------------------------------------------------------------------
// Semântica com o diccionário de elementos ordenados
//--------------------------------------------------------------------------
Chave  = ["BarrasH" , "BarrasV" , "BarrasD"     ];
Valor  = [ BarH     ,  BarV     , [Dia1, Dia2]  ];
Dados  = Dictionary.ByKeysValues( Chave , Valor );
# ----------------------------------------
